# Grasshopper definition PHOEBE 8.gh (Grasshopper 1.0.8)
# plug-ins: RhinoCodePluginGH

# 1 - Default
geometry = Geometry(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)
# 5 - Default
geometry_2 = Geometry(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)
# 2 - Default
geometry_3 = Geometry(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)
# 4 - Default
geometry_4 = Geometry([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])
# 3 - Default
geometry_5 = Geometry(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)
# 7 - Default
geometry_6 = Geometry([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])
# 6 - Default
geometry_7 = Geometry([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])
# 8 - Default
geometry_8 = Geometry(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)
# 9 - Default
geometry_9 = Geometry(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)
# 11 - Default
geometry_10 = Geometry(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)
# 10 - Default
geometry_11 = Geometry([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])
# 12 - Default
geometry_12 = Geometry([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])
# 13 - Default
geometry_13 = Geometry([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])
# 14 - Default
geometry_14 = Geometry(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)
mesh_brep = MeshBrep(
    Brep=geometry,
    Settings={GridMaxCount=0, GridMinCount=16, JaggedSeams=False, MaxEdgeLength=0, MinEdgeLength=0.0001, MinTolerance=0, Refine=True, RefineAngle=0, RelativeTolerance=0.65, SimplePlanes=True, Tolerance=0})
mesh_brep_2 = MeshBrep(
    Brep=geometry_2,
    Settings={GridMaxCount=0, GridMinCount=16, JaggedSeams=False, MaxEdgeLength=0, MinEdgeLength=0.0001, MinTolerance=0, Refine=True, RefineAngle=0, RelativeTolerance=0.65, SimplePlanes=True, Tolerance=0})
mesh_brep_3 = MeshBrep(
    Brep=geometry_5,
    Settings={GridMaxCount=0, GridMinCount=16, JaggedSeams=False, MaxEdgeLength=0, MinEdgeLength=0.0001, MinTolerance=0, Refine=True, RefineAngle=0, RelativeTolerance=0.65, SimplePlanes=True, Tolerance=0})
mesh_brep_4 = MeshBrep(
    Brep=geometry_3,
    Settings={GridMaxCount=0, GridMinCount=16, JaggedSeams=False, MaxEdgeLength=0, MinEdgeLength=0.0001, MinTolerance=0, Refine=True, RefineAngle=0, RelativeTolerance=0.65, SimplePlanes=True, Tolerance=0})
mesh_brep_5 = MeshBrep(
    Brep=geometry_4,
    Settings={GridMaxCount=0, GridMinCount=16, JaggedSeams=False, MaxEdgeLength=0, MinEdgeLength=0.0001, MinTolerance=0, Refine=True, RefineAngle=0, RelativeTolerance=0.65, SimplePlanes=True, Tolerance=0})
mesh_brep_6 = MeshBrep(
    Brep=geometry_7,
    Settings={GridMaxCount=0, GridMinCount=16, JaggedSeams=False, MaxEdgeLength=0, MinEdgeLength=0.0001, MinTolerance=0, Refine=True, RefineAngle=0, RelativeTolerance=0.65, SimplePlanes=True, Tolerance=0})
mesh_brep_7 = MeshBrep(
    Brep=geometry_6,
    Settings={GridMaxCount=0, GridMinCount=16, JaggedSeams=False, MaxEdgeLength=0, MinEdgeLength=0.0001, MinTolerance=0, Refine=True, RefineAngle=0, RelativeTolerance=0.65, SimplePlanes=True, Tolerance=0})
mesh_brep_8 = MeshBrep(
    Brep=geometry_8,
    Settings={GridMaxCount=0, GridMinCount=16, JaggedSeams=False, MaxEdgeLength=0, MinEdgeLength=0.0001, MinTolerance=0, Refine=True, RefineAngle=0, RelativeTolerance=0.65, SimplePlanes=True, Tolerance=0})
mesh_brep_9 = MeshBrep(
    Brep=geometry_10,
    Settings={GridMaxCount=0, GridMinCount=16, JaggedSeams=False, MaxEdgeLength=0, MinEdgeLength=0.0001, MinTolerance=0, Refine=True, RefineAngle=0, RelativeTolerance=0.65, SimplePlanes=True, Tolerance=0})
mesh_brep_10 = MeshBrep(
    Brep=geometry_9,
    Settings={GridMaxCount=0, GridMinCount=16, JaggedSeams=False, MaxEdgeLength=0, MinEdgeLength=0.0001, MinTolerance=0, Refine=True, RefineAngle=0, RelativeTolerance=0.65, SimplePlanes=True, Tolerance=0})
mesh_brep_11 = MeshBrep(
    Brep=geometry_11,
    Settings={GridMaxCount=0, GridMinCount=16, JaggedSeams=False, MaxEdgeLength=0, MinEdgeLength=0.0001, MinTolerance=0, Refine=True, RefineAngle=0, RelativeTolerance=0.65, SimplePlanes=True, Tolerance=0})
mesh_brep_12 = MeshBrep(
    Brep=geometry_12,
    Settings={GridMaxCount=0, GridMinCount=16, JaggedSeams=False, MaxEdgeLength=0, MinEdgeLength=0.0001, MinTolerance=0, Refine=True, RefineAngle=0, RelativeTolerance=0.65, SimplePlanes=True, Tolerance=0})
mesh_brep_13 = MeshBrep(
    Brep=geometry_13,
    Settings={GridMaxCount=0, GridMinCount=16, JaggedSeams=False, MaxEdgeLength=0, MinEdgeLength=0.0001, MinTolerance=0, Refine=True, RefineAngle=0, RelativeTolerance=0.65, SimplePlanes=True, Tolerance=0})
mesh_brep_14 = MeshBrep(
    Brep=geometry_14,
    Settings={GridMaxCount=0, GridMinCount=16, JaggedSeams=False, MaxEdgeLength=0, MinEdgeLength=0.0001, MinTolerance=0, Refine=True, RefineAngle=0, RelativeTolerance=0.65, SimplePlanes=True, Tolerance=0})
point = Point(Point(0, 0, 0))
curve = Curve([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])
mesh_join = MeshJoin(Meshes=mesh_brep)
mesh_join_2 = MeshJoin(Meshes=mesh_brep_2)
mesh_join_3 = MeshJoin(Meshes=mesh_brep_3)
mesh_join_4 = MeshJoin(Meshes=mesh_brep_4)
mesh_join_5 = MeshJoin(Meshes=mesh_brep_5)
mesh_join_6 = MeshJoin(Meshes=mesh_brep_6)
mesh_join_7 = MeshJoin(Meshes=mesh_brep_7)
mesh_join_8 = MeshJoin(Meshes=mesh_brep_8)
mesh_join_9 = MeshJoin(Meshes=mesh_brep_9)
mesh_join_10 = MeshJoin(Meshes=mesh_brep_10)
mesh_join_11 = MeshJoin(Meshes=mesh_brep_11)
mesh_join_12 = MeshJoin(Meshes=mesh_brep_12)
mesh_join_13 = MeshJoin(Meshes=mesh_brep_13)
mesh_join_14 = MeshJoin(Meshes=mesh_brep_14)
curve_2 = Curve([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])
point_2 = Point([Point(5, 0, 0), Point(6, 0, 1)])
curve_3 = Curve([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])
point_3 = Point([Point(10, 1, 0), Point(11, 1, 0), Point(11, 0, 0)])
curve_4 = Curve([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])
point_4 = Point([Point(2.5, 0, 0), Point(3.5, 0, 0)])
curve_5 = Curve([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])
point_5 = Point([Point(7.5, 0, 0), Point(8.5, 1, 1)])
curve_6 = Curve([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])
point_6 = Point([Point(13.5, 0, 0), Point(12.5, 0, 0), Point(13.5, 1, 1)])
curve_7 = Curve([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])
point_7 = Point([Point(16, 0, 0), Point(16, 1, 1), Point(15, 0, 1)])
curve_8 = Curve([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])
point_8 = Point([Point(18.5, 0, 0), Point(17.5, 0, 0), Point(18.5, 1, 0), Point(17.5, 1, 0)])
curve_9 = Curve([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])
point_9 = Point([Point(20, 0, 0), Point(21, 1, 0), Point(20, 1, 0), Point(20, 1, 1)])
curve_10 = Curve([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])
point_10 = Point([Point(25, 0, 0), Point(26, 1, 0), Point(26, 1, 1), Point(25, 1, 0)])
curve_11 = Curve([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])
point_11 = Point([Point(22.5, 0, 0), Point(23.5, 1, 0), Point(22.5, 0, 1), Point(23.5, 1, 1)])
curve_12 = Curve([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])
point_12 = Point([Point(28.5, 1, 0), Point(27.5, 1, 0), Point(28.5, 0, 0), Point(27.5, 0, 1)])
curve_13 = Curve([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])
point_13 = Point([Point(30, 0, 0), Point(31, 1, 0), Point(31, 0, 1), Point(30, 1, 1)])
curve_14 = Curve([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])
point_14 = Point([Point(33.5, 1, 0), Point(32.5, 1, 1), Point(33.5, 0, 0), Point(32.5, 1, 0)])
bbox = BoundingBox(Content=curve, Plane=PlaneXY(0, 0, 0), UnionBox=True)  # -> Box, Box_2
bbox_2 = BoundingBox(Content=curve_4, Plane=PlaneXY(0, 0, 0), UnionBox=True)  # -> Box, Box_2
bbox_3 = BoundingBox(Content=curve_2, Plane=PlaneXY(0, 0, 0), UnionBox=True)  # -> Box, Box_2
bbox_4 = BoundingBox(Content=curve_5, Plane=PlaneXY(0, 0, 0), UnionBox=True)  # -> Box, Box_2
bbox_5 = BoundingBox(Content=curve_11, Plane=PlaneXY(0, 0, 0), UnionBox=True)  # -> Box, Box_2
bbox_6 = BoundingBox(Content=curve_10, Plane=PlaneXY(0, 0, 0), UnionBox=True)  # -> Box, Box_2
bbox_7 = BoundingBox(Content=curve_7, Plane=PlaneXY(0, 0, 0), UnionBox=True)  # -> Box, Box_2
bbox_8 = BoundingBox(Content=curve_3, Plane=PlaneXY(0, 0, 0), UnionBox=True)  # -> Box, Box_2
bbox_9 = BoundingBox(Content=curve_6, Plane=PlaneXY(0, 0, 0), UnionBox=True)  # -> Box, Box_2
bbox_10 = BoundingBox(Content=curve_8, Plane=PlaneXY(0, 0, 0), UnionBox=True)  # -> Box, Box_2
bbox_11 = BoundingBox(Content=curve_9, Plane=PlaneXY(0, 0, 0), UnionBox=True)  # -> Box, Box_2
bbox_12 = BoundingBox(Content=curve_12, Plane=PlaneXY(0, 0, 0), UnionBox=True)  # -> Box, Box_2
bbox_13 = BoundingBox(Content=curve_13, Plane=PlaneXY(0, 0, 0), UnionBox=True)  # -> Box, Box_2
bbox_14 = BoundingBox(Content=curve_14, Plane=PlaneXY(0, 0, 0), UnionBox=True)  # -> Box, Box_2
create_a_reference_panel = Python3Script(mesh=mesh_join, box=bbox.Box, points=point, function="default")  # -> reference; inputs mesh: Mesh, box: Box, points: list of Point3d, function: String
# ---------- create_a_reference_panel: Python ----------
from compas.geometry import Box
from compas_rhino.conversions import *

class Reference(object):
    
    def __init__(self, box, points, tile, function):

        self.box = box
        self.points = points
        self.mesh = mesh
        self.function = function

        
    def get_centroid(self):
        centroid = self.box.frame.point
        return centroid
        

c_points = []
for pt in points:
    c_points.append(point_to_compas(pt))

box = box_to_compas(box)

mesh = mesh_to_compas(mesh)

reference = Reference(box, c_points, mesh, function)
# ---------- end create_a_reference_panel ----------
py3 = Python3Script(mesh=mesh_join_4, box=bbox_2.Box, points=point_4, function="default")  # -> reference; inputs mesh: Mesh, box: Box, points: list of Point3d, function: String; same code as create_a_reference_panel
py3_2 = Python3Script(mesh=mesh_join_3, box=bbox_3.Box, points=point_2, function="default")  # -> reference; inputs mesh: Mesh, box: Box, points: list of Point3d, function: String; same code as create_a_reference_panel
py3_3 = Python3Script(mesh=mesh_join_11, box=bbox_5.Box, points=point_11, function="default")  # -> reference; inputs mesh: Mesh, box: Box, points: list of Point3d, function: String; same code as create_a_reference_panel
py3_4 = Python3Script(mesh=mesh_join_9, box=bbox_6.Box, points=point_10, function="default")  # -> reference; inputs mesh: Mesh, box: Box, points: list of Point3d, function: String; same code as create_a_reference_panel
py3_5 = Python3Script(mesh=mesh_join_5, box=bbox_4.Box, points=point_5, function="default")  # -> reference; inputs mesh: Mesh, box: Box, points: list of Point3d, function: String; same code as create_a_reference_panel
py3_6 = Python3Script(mesh=mesh_join_7, box=bbox_7.Box, points=point_7, function="default")  # -> reference; inputs mesh: Mesh, box: Box, points: list of Point3d, function: String; same code as create_a_reference_panel
py3_7 = Python3Script(mesh=mesh_join_2, box=bbox_8.Box, points=point_3, function="default")  # -> reference; inputs mesh: Mesh, box: Box, points: list of Point3d, function: String; same code as create_a_reference_panel
py3_8 = Python3Script(mesh=mesh_join_6, box=bbox_9.Box, points=point_6, function="default")  # -> reference; inputs mesh: Mesh, box: Box, points: list of Point3d, function: String; same code as create_a_reference_panel
py3_9 = Python3Script(mesh=mesh_join_10, box=bbox_11.Box, points=point_9, function="default")  # -> reference; inputs mesh: Mesh, box: Box, points: list of Point3d, function: String; same code as create_a_reference_panel
py3_10 = Python3Script(mesh=mesh_join_12, box=bbox_12.Box, points=point_12, function="default")  # -> reference; inputs mesh: Mesh, box: Box, points: list of Point3d, function: String; same code as create_a_reference_panel
py3_11 = Python3Script(mesh=mesh_join_8, box=bbox_10.Box, points=point_8, function="default")  # -> reference; inputs mesh: Mesh, box: Box, points: list of Point3d, function: String; same code as create_a_reference_panel
py3_12 = Python3Script(mesh=mesh_join_13, box=bbox_13.Box, points=point_13, function="default")  # -> reference; inputs mesh: Mesh, box: Box, points: list of Point3d, function: String; same code as create_a_reference_panel
py3_13 = Python3Script(mesh=mesh_join_14, box=bbox_14.Box, points=point_14, function="default")  # -> reference; inputs mesh: Mesh, box: Box, points: list of Point3d, function: String; same code as create_a_reference_panel

# ---- group: Define ground
number_slider = Slider(1, range=0..10)
xy_plane = XYPlane(Origin=Point(0, 0, 0))
rectangular = Rectangular(Plane=xy_plane, SizeX=number_slider, SizeY=number_slider, ExtentX=Slider(6, range=1..40), ExtentY=Slider(6, range=1..40))  # -> simplify(Cells), Points

# ----
default = Data([create_a_reference_panel, py3, py3_2, py3_5, py3_7, py3_8, py3_6, py3_11, py3_9, py3_3, py3_4, py3_10, py3_12, py3_13])
panel = Panel("""default
default
default
default
default
default
default
default
default
default
default
default
default
default
default
default
default
default
default""")
generate_pannustheka = Python3Script(reference=default, generate=Toggle(False))  # -> pannustheka
# ---------- generate_pannustheka: Python ----------
import math
from compas.geometry import Transformation, Rotation, Translation, Reflection
from compas.geometry import Vector, Point

class Matrices(object):

    def get_roatation_matrix(axis, rotation_point):
        t0 = Matrices.get_identity_matrix()
        r1 = Rotation.from_axis_and_angle(axis, math.pi/2, rotation_point)
        r2 = Rotation.from_axis_and_angle(axis, math.pi, rotation_point)
        r3 = Rotation.from_axis_and_angle(axis, (math.pi/2)*3, rotation_point)
        rotation_list = [t0, r1, r2, r3]
        return rotation_list

    def get_reflection_matrix(centroid_point):
        t0 = Matrices.get_identity_matrix()
        mrx = Reflection.from_plane(([centroid_point[0], centroid_point[1], centroid_point[2]], [1,0,0]))
        mry = Reflection.from_plane(([centroid_point[0], centroid_point[1], centroid_point[2]], [0,1,0]))
        mrz = Reflection.from_plane(([centroid_point[0], centroid_point[1], centroid_point[2]], [0,0,1]))
        reflections_list = [t0, mrx, mry, mrz]
        return reflections_list

    def get_identity_matrix():  
        identity_matrix =   [[1.0000, 0.0000, 0.0000, 0.0000], 
                [0.0000, 1.0000, 0.0000, 0.0000], 
                [0.0000, 0.0000, 1.0000, 0.0000], 
                [0.0000, 0.0000, 0.0000, 1.0000]]
        return identity_matrix



class Pannus(object):

    def __init__(self, reference, rotation_x, rotation_y, rotation_z, reflection, transformed_points):
        self.points = transformed_points
        self.points_count = len(self.points)
        self.original_mesh = reference.mesh
        self.rotation_z = rotation_z
        self.rotation_x = rotation_x
        self.rotation_y = rotation_y
        self.reflection = reflection
        
        mesh = self.original_mesh.copy()
        mesh.transform(reflection)
        mesh.transform(rotation_z)
        mesh.transform(rotation_x)
        mesh.transform(rotation_y)
        self.mesh = mesh
        
        rule_string = []
        
        self.box = reference.box
        self.vertices = reference.box.points

        #generate passport index   
        for vertex in self.vertices:
            i = 0
            gate = True
            for point in self.points:
                if round(point.x, 3) == round(vertex.x, 3) and round(point.y, 3) == round(vertex.y, 3) and round(point.z, 3) == round(vertex.z, 3):
                    rule_string.append(1)
                    gate = False
                if i == self.points_count -1 and gate:
                    rule_string.append(0)
                i += 1

        self.rule = rule_string
        self.function = reference.function

    
    def generate_all_pemutations(reference, rotations_x, rotations_y, rotations_z, reflections):

        pannustheka = []
        
        for mr in reflections:                    
            for rz in rotations_z:
                for rx in rotations_x:
                    for ry in rotations_y:
                        transformed_points = Pannus.transform_points(reference.points, mr, rx, ry, rz)
                        pannus = Pannus(reference, rx, ry, rz, mr, transformed_points)
                        pannustheka.append(pannus)
                    
        return pannustheka

    
    def transform_points(points, reflection, rotation_x, rotation_y, rotation_z):
        point_group = []
        for point in points:
            pt = point.copy()
            pt.transform(reflection)
            pt.transform(rotation_z)
            pt.transform(rotation_x)
            pt.transform(rotation_y)
            point_group.append(pt)
        return point_group


    def get_file_name(self):
        file_name = self.function + "_" + str(self.rule) + ".3dm"
        return file_name



class Pannustheka(object):

    def __init__(self, reference, rotations_x, rotations_y, rotations_z, reflections):
        
        self.permutations = []
        
        for mr in reflections:                    
            for rz in rotations_z:
                for rx in rotations_x:
                    for ry in rotations_y:
                        transformed_points = Pannus.transform_points(reference.points, mr, rx, ry, rz)
                        pannus = Pannus(reference, rx, ry, rz, mr, transformed_points)
                        self.permutations.append(pannus)

    def delete_same_permutations(self):
    #    def delete_same_permutations(permutations):
        reduced_pannustheka = []
        identity_list = []
        
        for pannus in self.permutations:
            if pannus.rule not in identity_list:
                reduced_pannustheka.append(pannus)
                identity_list.append(pannus.rule)  
                
        self.permutations = reduced_pannustheka


        


if generate: 
    x_axis = Vector(1, 0, 0)
    y_axis = Vector(0, 1, 0)
    z_axis = Vector(0, 0, 1)

    centroid = reference.get_centroid()

    rotations_z = Matrices.get_roatation_matrix(z_axis, centroid)
    rotations_x = Matrices.get_roatation_matrix(x_axis, centroid)
    rotations_y = Matrices.get_roatation_matrix(y_axis, centroid)
    reflections = Matrices.get_reflection_matrix(centroid)


    pannustheka = Pannustheka(reference, rotations_x, rotations_y, rotations_z, reflections)

    pannustheka.delete_same_permutations()
# ---------- end generate_pannustheka ----------
create_floor = Python3Script(floor_functions=panel)  # -> floors; inputs floor_functions: list
# ---------- create_floor: Python ----------
class Floor(object):

    def __init__(self, number, function):
        self.number = number
        self.function = function



floors = []
for i, function in enumerate(floor_functions):
    floor = Floor(i, function)
    floors.append(floor)
# ---------- end create_floor ----------
pt = Point([Point(1.793444582, 4.418627055, 0), Point(2.558377861, 5.206040834, 0), Point(3.576414063, 4.418627055, 0), Point(4.062785653, 0.3168982509, 0), Point(2.462761201, 2.365681123, 0), Point(2.462761201, 1.21503369, 0)])
create_blueprint = Python3Script(floors=create_floor)  # -> blueprint, ascii_section; inputs floors: list
# ---------- create_blueprint: Python ----------
#List of floors and their functions:


class Blueprint(object):

    def __init__(self, floors):
        self.floors = floors


    def get_ASCII_blueprint(self):
        
        ascii = "      ____________________     \n"
        ascii +=".    /                    \\     "


        for i, floor in enumerate(self.floors):

            floor_number = floor.number
            function = floor.function

            string_length = len(list(function))
            white_spaces_number = 20 - string_length

            half_spaces_float = white_spaces_number / 2
            half_spaces_int = int(half_spaces_float)
            
            white_spaces = []
            one_space = ""

            for i in range(0, half_spaces_int, 1):
                white_spaces.append(" ")
                if (white_spaces_number % 2 == 1):
                    one_space = " "
            
            white_spaces = "".join(white_spaces)

            ascii += ("\n     |{}{}{}{}|              {}. Floor".format(white_spaces, function.upper(), white_spaces, one_space, floor_number))
            
        ascii += "\n________________________________\n"
        ascii += "////////////////////////////////"

        return ascii


floors.reverse()
blueprint = Blueprint(floors)
ascii_section = blueprint.get_ASCII_blueprint()
# ---------- end create_blueprint ----------
create_alive_scheme = Python3Script(cells=rectangular.Cells, points=pt)  # -> alive_scheme; inputs cells: tree, points: list
# ---------- create_alive_scheme: Python ----------
import rhinoscriptsyntax as rs
import ghpythonlib.treehelpers as th



alive_scheme = []

for i in range(cells.BranchCount):
    cells_list = cells.Branch(i)
    branchPath = cells.Path(i)
    
    for j in range(cells_list.Count):
        
        
        for point in points:
            bool = rs.PointInPlanarClosedCurve(point, cells_list[j])
            if bool == 1:
                print (i, j, bool)
                alive_cell = [i, j]
                alive_scheme.append(alive_cell)



print(alive_scheme)
# ---------- end create_alive_scheme ----------
visualize_pannustheka = Python3Script(pannustheka=generate_pannustheka)  # -> pannus, bbox, points
# ---------- visualize_pannustheka: Python ----------
import rhinoscriptsyntax as rs
from compas_rhino.conversions import point_to_compas, line_to_rhino, point_to_rhino, mesh_to_rhino, box_to_rhino
from ghpythonlib.componentbase import executingcomponent as component
from compas.scene import SceneObject
from compas.geometry import Vector, Point, Translation

origin = pannustheka.permutations[0].box.frame.point.copy()

pannus = []
bbox = []
points = []



#DRAW ALL PERMUTATIONS
for permutation in pannustheka.permutations:

    mesh = permutation.mesh.copy()
    box = permutation.box.copy()
    c_points = permutation.points.copy()
    
   
    translation_vector = Vector.from_start_end(box.frame.point, origin)
    translation_matrix = Translation.from_vector(translation_vector)
    

    #DRAW TILES
    mesh.transform(translation_matrix)
    pannus.append(mesh_to_rhino(mesh))

    
    #DRAW BOUNDING BOX
    box.transform(translation_matrix)
    bbox.append(box_to_rhino(box))
        
    
    #DRAW POINTS
    for pt in c_points:
        pt.transform(translation_matrix)
        points.append(point_to_rhino(pt))
        
    

    origin.z = origin.z + 5
# ---------- end visualize_pannustheka ----------
panel_2 = Panel(create_blueprint.ascii_section)
wires = BrepWireframe(Brep=visualize_pannustheka.bbox, Density=-1)
pannustheka = FilePath("C:\Users\computer-1\Documents\PANNUSTHEKA\")
cellular_automata = Python3Script(
    grid=rectangular.Cells,
    alive_scheme=create_alive_scheme,
    blueprint=create_blueprint.blueprint,
    run_cellular_automata=Toggle(True))  # -> organism, voxels; inputs grid: tree of Rectangle3d, alive_scheme: list
# ---------- cellular_automata: Python ----------
#r: compas

import compas
from compas.geometry import Box, Point, Line
from compas_rhino.conversions import box_to_rhino


"""
******************************************
VOXEL CLASS
******************************************
"""
class Voxel(object):

    def __init__(self, status, generation, row, index, function):
        self.status = status
        self.generation = generation
        self.row = row
        self.index = index
        
        self.shape = Box
        
        self.corner0 = None
        self.corner2 = None
        
        self.height = 1
        
        self.function = function
   
    def from_corner_corner_voxel(voxel, corner0, corner2):
        new_voxel = Voxel(voxel.status, voxel.generation, voxel.row, voxel.index, voxel.function)
        new_voxel.corner0 = corner0
        new_voxel.corner2 = corner2
        return new_voxel

    def is_alive(self): #return true if the voxel is alive, false if is dead
        return(self.status)


    def live(self):
        self.status = True


    def die(self):
        self.status = False

        
    def draw_box(self):
        box = Box.from_corner_corner_height(self.corner0, self.corner2, self.height)
        return(box)


    def define_corner_0(self, x, y, z):
        self.corner0 = Point(x, y, z)

    def define_corner_2(self, x, y, z):
        self.corner2 = Point(x, y, z)

    def get_vertices_points(self):
        box = self.draw_box()
        points = box.points
        return points

    def get_rule(self, point_cloud):
        rule_string = []

        cell_vertices = self.get_vertices_points()

        for vertex in cell_vertices:            
            gate = True
            i = 0
            
            for point in point_cloud:
                if round(point.x, 3) == round(vertex.x, 3) and round(point.y, 3) == round(vertex.y, 3) and round(point.z, 3) == round(vertex.z, 3):
                    rule_string.append(1)
                    gate = False
                if i == len(point_cloud) -1 and gate:
                    rule_string.append(0)
                
                i += 1
        
        return rule_string




"""
******************************************
CLASS ORGANISM
******************************************
"""

class Organism(object):

    def __init__(self, max_generations, blueprint, grid):

        self.generations = max_generations
        self.blueprint = blueprint

        self.grid = grid
        self.n_rows = grid.BranchCount
        self.n_indices = len(grid.Branch(0))

        self.original_voxels = []
        self.voxels = []
        self.small_voxels = []

        self.last_generation = []
        self.new_generation = []

        self.extinct_generation = None

    def set_generation_zero(self, alive_scheme):

        generation = 0
        function = self.blueprint.floors[0].function
        for i in range(self.grid.BranchCount):
            row = i
            branch_list = self.grid.Branch(i)
            for j in range(len(branch_list)):
                index = j
                
                #define the voxel
                voxel = Voxel(False, generation, row, index, function)
                
                #give the voxels the coordintes
                corners = []

                rectangle = branch_list[j]
                corner0 = rectangle.Corner(0)
                corner2 = rectangle.Corner(2)
                                
                voxel.define_corner_0(corner0.X, corner0.Y, corner0.Z)
                voxel.define_corner_2(corner2.X, corner2.Y, corner2.Z)

                #append to the voxel list
                self.add_voxel(voxel)



        #implement the initial condition
        for voxel in self.voxels:
            for i in range(len(alive_scheme)):
                if voxel.row == alive_scheme[i][0] and voxel.index == alive_scheme[i][1]:
                    voxel.live()

    def add_voxel(self, voxel):
        self.voxels.append(voxel)

    def remove_all_voxels(self):
        self.voxels = []

    def get_voxels(self):
        voxels = []
        for voxel in self.voxels:
            voxels.append(voxel)
        return voxels

    def get_generation_function(self, generation_index):
        for floor in self.blueprint.floors:
            if(floor.number == generation_index):
                return floor.function

    def set_last_generation(self, voxels):
        for voxel in voxels:
            self.last_generation.append(voxel)
 
    def add_new_generation(self, generation_index):
        new_generation_voxels = []
        i = 0

        for voxel in self.last_generation:
            
            row = voxel.row
            index = voxel.index
            generation = generation_index
            status = False
            
            function = self.get_generation_function(generation_index)
        
            new_voxel = Voxel(status, generation, row, index, function)

            new_voxel.define_corner_0(voxel.corner0.x, voxel.corner0.y, voxel.corner0.z + voxel.height)
            new_voxel.define_corner_2(voxel.corner2.x, voxel.corner2.y, voxel.corner2.z + voxel.height)
            
            self.new_generation.append(new_voxel)
    
    def get_alive_neighbours(self, voxel):

        alive_neighbours = 0
        just_under_voxel = False
        row = voxel.row
        index = voxel.index
        
        for last_gen_voxel in self.last_generation:
            
            row_last = last_gen_voxel.row
            index_last = last_gen_voxel.index
                
            if row_last == row-1:
                if index_last == index-1:
                    if last_gen_voxel.is_alive():
                        alive_neighbours = alive_neighbours+1
                        
                elif index_last == index:
                    if last_gen_voxel.is_alive():
                        alive_neighbours = alive_neighbours+1
                        
                elif index_last == index+1:
                    if last_gen_voxel.is_alive():
                        alive_neighbours = alive_neighbours+1
                            
            elif row_last == row:
                if index_last == index-1:
                    if last_gen_voxel.is_alive():
                        alive_neighbours = alive_neighbours+1
                        
                elif index_last == index:
                    if last_gen_voxel.is_alive():
                        just_under_voxel = True
                        
                elif index_last == index+1:
                    if last_gen_voxel.is_alive():
                        alive_neighbours = alive_neighbours+1
                                  
            elif row_last == row + 1:
                if index_last == index-1:
                    if last_gen_voxel.is_alive():
                        alive_neighbours = alive_neighbours+1
                        
                elif index_last == index:
                    if last_gen_voxel.is_alive():
                        alive_neighbours = alive_neighbours+1
                        
                elif index_last == index+1:
                    if last_gen_voxel.is_alive():
                        alive_neighbours = alive_neighbours+1
                            
        return alive_neighbours, just_under_voxel

    def conways_rules(self, voxel, alive_neighbours, just_under_voxel):

        if just_under_voxel:
            if alive_neighbours < 2:
                voxel.die()
            elif alive_neighbours > 3:
                voxel.die()
            elif alive_neighbours == 2 or alive_neighbours == 3:
                voxel.live()

        elif not just_under_voxel and alive_neighbours == 3:
            voxel.live()



    def check_boundaries(self, voxel):
        if voxel.generation == self.generations-1:
            voxel.die()
        if voxel.index == 0 or voxel.index == self.n_indices -1:
            voxel.die()
        if voxel.row == 0 or voxel.row == self.n_rows-1:
            voxel.die()
        self.check_extinction()
        if voxel.generation == self.extinct_generation + 1:
            voxel.die()


    def is_dead_or_alive(self):
        for voxel in self.new_generation:
            reference_voxel = False        
            alive_neighbours, just_under_voxel = self.get_alive_neighbours(voxel)               
            self.conways_rules(voxel, alive_neighbours, just_under_voxel)
            self.check_boundaries(voxel)

    def update_generations(self):
        self.last_generation = []
        for voxel in self.new_generation:
            self.last_generation.append(voxel)
        self.new_generation = []

    def cellular_automata(self):
        self.set_last_generation(self.get_voxels())

        for generation_index in range(1, self.generations): 

            self.add_new_generation(generation_index)
            for voxel in self.new_generation:
                self.add_voxel(voxel)
            self.is_dead_or_alive()
            self.update_generations()

        voxels = organism.get_voxels()
        self.voxels_backup()
        return voxels

    def voxels_backup(self):
        self.original_voxels = self.voxels.copy()

    def increase_cell_density(self, division_factor):
        self.small_voxels = []
        for voxel in self.original_voxels:
            voxel_box = voxel.draw_box()

            #scale the boc to the right dimension
            

            #position the box to the right place
            corner0 = voxel_box.corner(0)
            corner2 = voxel_box.corner(6)

            diagonal = Line(corner0, corner2) 
            small_corner0 = corner0            
            small_corner2 = diagonal.point_at(1.0 / division_factor)

            #create new voxel
            for x in range(0, division_factor):
                for y in range(0, division_factor):
                    for z in range(0, division_factor):

                        corner0 = Point(small_corner0.x + 1/division_factor * x, small_corner0.y + 1/division_factor * y, small_corner0.z + 1/division_factor * z)
                        corner2 = Point(small_corner2.x + 1/division_factor * x, small_corner2.y + 1/division_factor * y, small_corner2.z + 1/division_factor * z)
                        corner2.z = corner0.z
                        small_voxel = Voxel.from_corner_corner_voxel(voxel, corner0, corner2)
                        small_voxel.height = voxel.height/division_factor
                        self.small_voxels.append(small_voxel)
        
    def update_voxels_list_with_small_voxels(self):
        self.voxels = []
        for voxel in self.small_voxels:
            self.voxels.append(voxel)
        self.small_voxels = []

    def get_alive_cells(self):
        alive_cells = []
        for voxel in self.voxels:
            if voxel.is_alive():
                alive_cells.append(voxel)
        return alive_cells

    def get_dead_cells(self):
        dead_cells = []
        for voxel in self.voxels:
            if not voxel.is_alive():
                dead_cells.append(voxel)
        return dead_cells
                
    def is_neighbour_voxel_alive(self, voxel):
        alive_neighbours = 0
        row = voxel.row
        index = voxel.index
        generation = voxel.generation
        
        for vx in self.voxels:
            if vx.generation == generation-1 or vx.generation == generation or vx.generation == generation+1:
                if vx.row == row-1:
                    if vx.index == index-1:
                        if vx.is_alive():
                            alive_neighbours = alive_neighbours+1
                            
                    elif vx.index == index:
                        if vx.is_alive():
                            alive_neighbours = alive_neighbours+1
                            
                    elif vx.index == index+1:
                        if vx.is_alive():
                                alive_neighbours = alive_neighbours+1

                elif vx.row == row:
                    if vx.index == index-1:
                        if vx.is_alive():
                            alive_neighbours = alive_neighbours+1
                            
                    elif vx.index == index:
                        if vx.is_alive():
                            alive_neighbours = alive_neighbours+1
                            
                    elif vx.index == index+1:
                        if vx.is_alive():
                            alive_neighbours = alive_neighbours+1

                elif vx.row == row + 1:
                    if vx.index == index-1:
                        if vx.is_alive():
                                alive_neighbours = alive_neighbours+1
                            
                    elif vx.index == index:
                        if vx.is_alive():
                            alive_neighbours = alive_neighbours+1
                            
                    elif vx.index == index+1:
                        if vx.is_alive():
                            alive_neighbours = alive_neighbours+1
                        
        if alive_neighbours > 0: 
            return True
        else:
            return False


    def check_extinction(self):
        generation = 0
        for voxel in self.voxels:
            if voxel.generation > generation and voxel.is_alive():
                generation += 1
        self.extinct_generation = generation



"""
******************************************
MAIN
******************************************
"""

### INITIATE
max_generations = len(blueprint.floors)

organism = Organism(max_generations, blueprint, grid)
organism.set_generation_zero(alive_scheme)

voxels = organism.get_voxels()

### CELLULAR AUTOMATA
if run_cellular_automata:
    voxels = organism.cellular_automata()
# ---------- end cellular_automata ----------
export_pannustheka = Python3Script(pannustheka=generate_pannustheka, file_path=pannustheka, export=Toggle(False))  # -> out, a
# ---------- export_pannustheka: Python ----------
import rhinoscriptsyntax as rs
import Rhino.FileIO
import System
from compas_rhino.conversions import mesh_to_rhino, point_to_rhino, box_to_rhino



def export_file(mesh, points, vertices, file_path_function):
    #set the file
    file_to_export = Rhino.FileIO.File3dm()
    
    #set the layers
    layer_table = file_to_export.AllLayers
    
    layer_table.AddLayer("mesh", System.Drawing.Color.Black)
    layer_table.AddLayer("points", System.Drawing.Color.Red)
    layer_table.AddLayer("bounding_box_points", System.Drawing.Color.Blue)
    
    
    #add the objects
    object_table = file_to_export.Objects
    objects_attributes = Rhino.DocObjects.ObjectAttributes()
    
    
    objects_attributes.LayerIndex = 0
    object_table.AddMesh(mesh, objects_attributes) 

    
    
    objects_attributes.LayerIndex = 1
    if isinstance(points, list):
        for p in points:
            object_table.AddPoint(p, objects_attributes)
    else:
        object_table.AddPoint(points, objects_attributes)


    objects_attributes.LayerIndex = 2
    if isinstance(vertices, list):
        for p in vertices:
            object_table.AddPoint(p, objects_attributes)
    else:
        object_table.AddPoint(points, objects_attributes)
    

        
    
    #export it
    write_options = Rhino.FileIO.File3dmWriteOptions()
    write_options.Version = 7
    file_to_export.Write(file_path_function, write_options)
    
    
    
if export:
    for permutation in pannustheka.permutations:
        
        specific_file_path = file_path + permutation.get_file_name()

        specific_mesh = mesh_to_rhino(permutation.mesh)
        specific_points = []
        for pt in permutation.points: specific_points.append(point_to_rhino(pt))
        specific_vertices = []
        for pt in permutation.vertices: specific_vertices.append(point_to_rhino(pt))

        export_file(specific_mesh, specific_points, specific_vertices, specific_file_path)
# ---------- end export_pannustheka ----------
custom_preview = CustomPreview(Geometry=visualize_pannustheka.pannus, Material=ColourSwatch(SwatchColor=RGB(61, 172, 227)))
custom_preview_2 = CustomPreview(Geometry=wires, Material=ColourSwatch(SwatchColor=RGB(150, 150, 150)))
custom_preview_3 = CustomPreview(Geometry=visualize_pannustheka.points, Material=ColourSwatch(SwatchColor=RGB(255, 0, 0)))
prepare_cellular_automata = Python3Script(organism=cellular_automata.organism, division_factor=Slider(2, range=1..3))  # -> voxels, alive_cells, dead_cells, point_cloud, intresting_cells; inputs division_factor: Int32
# ---------- prepare_cellular_automata: Python ----------
import rhinoscriptsyntax as rs
from compas.geometry import Point, Line, Curve
from compas_rhino.conversions import box_to_rhino, point_to_rhino, point_to_compas

"""
FUNCTIONS
"""


def remove_duplicate_points(point_cloud):
    new_point_cloud = []
    [new_point_cloud.append(x) for x in point_cloud if x not in new_point_cloud]
    return new_point_cloud


def check_cell_distance(cell, point_cloud, dimension):
    cell_center_point = cell.draw_box().frame.point

    for point in point_cloud:
        if point.distance_to_point(cell_center_point) < dimension:
            return cell

def get_intresting_cells(point_cloud, cells):
    
    intresting_cells = []
    dimension = cells[0].draw_box().xsize
    
    for cell in cells:
        cell_center_point = cell.draw_box().frame.point
        checked_cell = check_cell_distance(cell, point_cloud, dimension)
        if checked_cell != None:
            intresting_cells.append(checked_cell)
    
    return intresting_cells


"""
MAIN
"""

organism.increase_cell_density(division_factor)
organism.update_voxels_list_with_small_voxels()

voxels = organism.get_voxels()


alive_cells = organism.get_alive_cells()
dead_cells = organism.get_dead_cells()

#keep dead cells only if they are near an alive cell
trimmed_dead_cells = []
for cell in dead_cells:
    if organism.is_neighbour_voxel_alive(cell):
        trimmed_dead_cells.append(cell)

dead_cells = []
dead_cells = trimmed_dead_cells.copy()


#create the point cloud
point_cloud = []

for cell in alive_cells:
    points = cell.get_vertices_points()
    for pt in points:
        point_cloud.append(pt)

point_cloud = remove_duplicate_points(point_cloud)



#get the intresting cells
intresting_cells = get_intresting_cells(point_cloud, dead_cells)
# ---------- end prepare_cellular_automata ----------
visualize_alive_voxels = Python3Script(voxels=prepare_cellular_automata.alive_cells)  # -> geometry; inputs voxels: list
# ---------- visualize_alive_voxels: Python ----------
from compas_rhino.conversions import box_to_rhino
geometry = []

for v in voxels:
    if v.is_alive():
        box = v.draw_box()
        geometry.append(box_to_rhino(box))
# ---------- end visualize_alive_voxels ----------
custom_preview_4 = CustomPreview(Geometry=visualize_alive_voxels, Material=ColourSwatch(SwatchColor=RGB(95, 131, 158)))
pannustheka_2 = FilePath("C:\Users\computer-1\Documents\PANNUSTHEKA\")
marching_cubes = Python3Script(
    point_cloud=prepare_cellular_automata.point_cloud,
    interesting_cells=prepare_cellular_automata.intresting_cells,
    library=pannustheka_2,
    start_marching=Toggle(True))  # -> out, envelope; inputs point_cloud: list, interesting_cells: list
# ---------- marching_cubes: Python ----------
import rhinoscriptsyntax as rs
from compas_rhino.conversions import point_to_compas, mesh_to_compas
from compas.geometry import Transformation, Translation, Vector, Scale, Frame

import Rhino.FileIO
import os



class Permutation(object):
    def __init__(self):
        self.mesh = None
        self.points = None
        self.bounding_box_points = None


    def import_from_pannustheka(self, cell, rule):

        function = cell.function
        if function == None: function = "default"

        if len(rule) > 8 or len(rule) < 8: return None
        if rule == [0,0,0,0,0,0,0,0] or rule == [1,1,1,1,1,1,1,1]:
            return None

        i=0
        for index in rule:
            i = i+index

        if i > 4:
            inverted_rule = []
            for index in rule:
                if index == 0:
                    inverted_rule.append(1)
                else:
                    inverted_rule.append(0)
            rule = inverted_rule

        file_path = library + function + "_" + str(rule) + ".3dm"
        #open the file
        try:
            model = Rhino.FileIO.File3dm.Read(file_path)
        except:
            #return None
            pass
        #get all objects
        objects = model.Objects
        
        #get layer table
        layer_table = model.AllLayers
        
        #get all objects geometry
        geometries = []
        points_list = []
        bbpoints_list = []
        

        for obj in objects:
                    
            if(obj.Attributes.LayerIndex == 0):
                mesh = obj.Geometry
            elif(obj.Attributes.LayerIndex == 1):
                points_list.append(obj.Geometry.Location)
            elif(obj.Attributes.LayerIndex == 2):
                bbpoints_list.append(obj.Geometry.Location)
                                
        mesh = mesh_to_compas(mesh)
        points_list = points_to_compas(points_list)
        bbpoints_list = points_to_compas(bbpoints_list)

        self.mesh = mesh
        self.points = points_list
        self.bounding_box_points = bbpoints_list





class MarchingCubes(object):

    def __init__(self, interesting_cells, point_cloud):

        self.envelope = []

        self.interesting_cells = interesting_cells
        self.point_cloud = point_cloud

        self.scale_x_factor = None
        self.scale_y_factor = None
        self.scale_z_factor = None


        self.set_scale_factor()




    def set_scale_factor(self):
        cell_box = self.interesting_cells[0].draw_box()

        self.scale_x_factor = cell_box.xsize 
        self.scale_y_factor = cell_box.ysize
        self.scale_z_factor = cell_box.zsize 





    
    def add_permutation(self, permutation, destination_cell):
        #def move_panel(permutation, cell_all_points, x_factor, y_factor, z_factor):
        if permutation is not None:
            translation_vector = Vector.from_start_end(permutation.bounding_box_points[0], destination_cell.get_vertices_points()[0])
            translation_matrix = Translation.from_vector(translation_vector)
            
            transformation_origin = Frame.from_points(permutation.bounding_box_points[0], permutation.bounding_box_points[1], permutation.bounding_box_points[3])
            
            scale_transformation = Scale.from_factors([self.scale_x_factor, self.scale_y_factor, self.scale_z_factor], transformation_origin)
            
            tile = permutation.mesh.copy()
            tile.transform(scale_transformation)
            tile.transform(translation_matrix)
            self.envelope.append(tile)






    def run_marching_cubes(self):
        
        for cell in self.interesting_cells:

            cell_vertices = []
            for i in range(0, 8):
                cell_vertices.append(cell.draw_box().corner(i))
            

            cell_rule = cell.get_rule(self.point_cloud)

            permutation = Permutation()
            permutation.import_from_pannustheka(cell, cell_rule)

            if permutation.mesh is not None:
                marching_cube.add_permutation(permutation, cell)
    

# =========================================================================================
# FUNCTIONS FUNCTIONS FUNCTIONS FUNCTIONS FUNCTIONS FUNCTIONS FUNCTIONS FUNCTIONS FUNCTIONS
# =========================================================================================
def points_to_compas(points):
    compas_points = []
    for pt in points:
        compas_points.append(point_to_compas(pt))
    return compas_points
    

def meshes_to_compas(meshes):
    mesh_compas = []
    for m in meshes:
        mesh_compas.append(mesh_to_compas(m))
    return mesh_compas
    
# =========================================================================================
# FUNCTIONS FUNCTIONS FUNCTIONS FUNCTIONS FUNCTIONS FUNCTIONS FUNCTIONS FUNCTIONS FUNCTIONS
# =========================================================================================



if start_marching:
    

    marching_cube = MarchingCubes(interesting_cells, point_cloud)

    marching_cube.set_scale_factor()

    marching_cube.run_marching_cubes()

    envelope = marching_cube.envelope
# ---------- end marching_cubes ----------
visualize_envelope = Python3Script(envelope=marching_cubes.envelope)  # -> geometry; inputs envelope: list
# ---------- visualize_envelope: Python ----------
from compas_rhino.conversions import mesh_to_rhino

geometry = []

for m in envelope:
    geometry.append(mesh_to_rhino(m))
# ---------- end visualize_envelope ----------
custom_preview_5 = CustomPreview(Geometry=visualize_envelope, Material=ColourSwatch(SwatchColor=RGB(140, 102, 158)))
